# Grasshopper definition 2024_BASELINE_Workflow_without_plaster.gh (Grasshopper 1.0.7)
# plug-ins: CORE.Toolbox.Grasshopper

# ----
# Input Rhino
doors = Geometry([<brep referenced from the Rhino model> x4])
windows = Geometry([<brep referenced from the Rhino model> x5])
internal_walls = Surface([<surface referenced from the Rhino model> x8])
closedsrfbuilding = Geometry(<brep referenced from the Rhino model>)

area = Area(Geometry=internal_walls)  # -> Area, Centroid
panel = Panel(closedsrfbuilding)
volume = Volume(Geometry=closedsrfbuilding)  # -> Volume, Centroid
panel_2 = Panel(area.Area)

# ----
# Walls and Roof
number_slider = Slider(0.3, range=0..1)
# Construction Sets
panel_3 = Panel("compressed earth bricks")
number = Number(0.7)
number_2 = Number(0.643)
number_3 = Number(1900)
number_4 = Number(0.64)
number_5 = Number(868)
opaquemat = HBOpaqueMaterial(
    name=panel_3,
    thickness=number_slider,
    conductivity=number_2,
    density=number_3,
    spec_heat=number_5,
    therm_absp=number_4,
    sol_absp=number,
    vis_absp=number)  # -> mat; plug-in component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

panel_4 = Panel(volume.Volume)
panel_5 = Panel(windows)
panel_6 = Panel(internal_walls)
panel_7 = Panel(doors)

# ----
# Floor (insulation)
num = Number(1450)
num_2 = Number(0.05)
num_3 = Number(0.03)
num_4 = Number(28)
panel_8 = Panel([num_2, num_3, num_4, num])
opaquemat_2 = HBOpaqueMaterial(name="floor_XPS", thickness=num_2, conductivity=num_3, density=num_4, spec_heat=num)  # -> mat; plug-in component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

# ----
# Floor (concrete)
num_5 = Number(1.373)
num_6 = Number(2104)
num_7 = Number(776)
num_8 = Number(0.15)
opaquemat_3 = HBOpaqueMaterial(name="floor_concrete", thickness=num_8, conductivity=num_5, density=num_6, spec_heat=num_7)  # -> mat; plug-in component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

# ----
# Floor (concrete)
num_9 = Number(0.05)
opaquemat_4 = HBOpaqueMaterial(name="floor_concrete", thickness=num_9, conductivity=num_5, density=num_6, spec_heat=num_7)  # -> mat; plug-in component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

# ----
# Windows
number_6 = Number(2.73)
number_7 = Number(0.6)
panel_9 = Panel([number_6, number_7])
windowmat = HBWindowMaterial(name="windows", u_factor=number_6, shgc=number_7)  # -> mat; plug-in component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
windowconstr = HBWindowConstruction(materials=windowmat)  # -> constr; plug-in component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

panel_10 = Panel([num_8, num_5, num_6, num_7])

# ----
# Doors
panel_11 = Panel("glass doors")
num_10 = Number(2.73)
num_11 = Number(0.6)
windowmat_2 = HBWindowMaterial(name=panel_11, u_factor=num_10, shgc=num_11)  # -> mat; plug-in component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
windowconstr_2 = HBWindowConstruction(materials=windowmat_2)  # -> constr; plug-in component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

bool = Boolean(True)
opaquemat_5 = HBOpaqueMaterial(
    name="hygroscopic plaster",
    thickness=Slider(0.03, range=0..1),
    conductivity=Slider(0.8, range=0..1),
    density=Slider(1900, range=-1..1000000),
    spec_heat=Slider(850, range=-1..1000000))  # -> mat; plug-in component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
panel_12 = Panel([number_2, number_3, number_5, number_4, number])

# ----
# Floor
merge = Merge(Data1=opaquemat_3, Data2=opaquemat_2, Data3=opaquemat_4)
opaqueconstr = HBOpaqueConstruction(materials=merge)  # -> flatten(constr); plug-in component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

merge_2 = Merge(Data1=opaquemat)
face = HBFace(geo=internal_walls, bc="adiabatic")  # -> report, faces; plug-in component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

# ----
# Geometry
roomsolid = HBRoomFromSolid(geo=flatten(closedsrfbuilding), conditioned=True)  # -> out, rooms; plug-in component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
door = HBDoor(geo=doors, glass=bool)  # -> out, doors; plug-in component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
aperture = HBAperture(geo=windows)  # -> out, apertures; plug-in component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
addsubface = HBAddSubface(hb_obj=flatten(roomsolid.rooms), sub_faces=flatten([aperture.apertures, door.doors]))  # -> hb_obj; plug-in component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
model = HBModel(rooms=flatten(addsubface))  # -> out, model; plug-in component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
facesbytype = HBFacesByType(hb_objs=[model.model, face.faces])  # -> walls, interior_walls, roofs, ceilings, exterior_floors, interior_floors, air_walls, apertures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; plug-in component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

merge_3 = Merge(Data1=opaquemat)
opaqueconstr_2 = HBOpaqueConstruction(materials=merge_3)  # -> constr; plug-in component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
opaqueconstr_3 = HBOpaqueConstruction(materials=merge_2)  # -> constr; plug-in component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
interiorsubset = HBInteriorConstructionSubset(interior_wall=opaqueconstr_2)  # -> interior_set; plug-in component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
subfacesubset = HBSubfaceSubset(window=windowconstr, glass_door=windowconstr_2)  # -> subface_set; plug-in component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
exteriorsubset = HBExteriorConstructionSubset(exterior_wall=opaqueconstr_3, exterior_roof=opaqueconstr_3, exposed_floor=opaqueconstr)  # -> exterior_set; plug-in component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
panel_13 = Panel(exteriorsubset)
panel_14 = Panel(interiorsubset)
constructionset = HBConstructionSet(exterior_subset=exteriorsubset, interior_subset=interiorsubset, subface_subset=subfacesubset)  # -> constr_set; plug-in component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

# ----
# Exterior walls
vizquick = HBVizualizeQuick(hb_objs=flatten(facesbytype.walls))  # -> geo; plug-in component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
area_2 = Area(Geometry=vizquick)  # -> Area, Centroid
mass_addition = MassAddition(Input=area_2.Area)  # -> Result, PartialResults

# ----
# Interior walls
vizquick_2 = HBVizualizeQuick(hb_objs=flatten(facesbytype.interior_walls))  # -> geo; plug-in component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
area_3 = Area(Geometry=vizquick_2)  # -> Area, Centroid
mass_addition_2 = MassAddition(Input=area_3.Area)  # -> Result, PartialResults

# ----
# Roof
vizquick_3 = HBVizualizeQuick(hb_objs=flatten(facesbytype.roofs))  # -> geo; plug-in component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
area_4 = Area(Geometry=vizquick_3)  # -> Area, Centroid
mass_addition_3 = MassAddition(Input=area_4.Area)  # -> Result, PartialResults

# ----
# Floor
vizquick_4 = HBVizualizeQuick(hb_objs=flatten(facesbytype.exterior_floors))  # -> geo; plug-in component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
area_5 = Area(Geometry=vizquick_4)  # -> Area, Centroid
mass_addition_4 = MassAddition(Input=area_5.Area)  # -> Result, PartialResults

# ----
# Arperture
vizquick_5 = HBVizualizeQuick(hb_objs=flatten(facesbytype.roofs))  # -> geo; plug-in component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
area_6 = Area(Geometry=vizquick_5)  # -> Area, Centroid
mass_addition_5 = MassAddition(Input=area_6.Area)  # -> Result, PartialResults

# ----
# Doors
vizquick_6 = HBVizualizeQuick(hb_objs=flatten(facesbytype.doors))  # -> geo; plug-in component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
area_7 = Area(Geometry=vizquick_6)  # -> Area, Centroid
mass_addition_6 = MassAddition(Input=area_7.Area)  # -> Result, PartialResults

# ----
# R-Values
decnstrconstrset = HBDeconstructConstructionSet(constr_set=constructionset)  # -> exterior_wall, exterior_roof, exposed_floor, ground_wall, ground_roof, ground_floor, window, skylight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; plug-in component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
decnstrconstr = HBDeconstructConstruction(constr=[decnstrconstrset.exterior_wall, decnstrconstrset.exterior_roof, decnstrconstrset.exposed_floor, decnstrconstrset.window])  # -> materials, layers, r_val_si, r_val_ip, u_fac_si, u_fac_ip, shgc, t_sol, t_vis; plug-in component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
r_value_1_walls_2_roof_3_floor_4_windows = Panel(decnstrconstr.u_fac_si)

panel_15 = Panel(decnstrconstrset.exterior_roof)
panel_16 = Panel(mass_addition_4.Result)

# ----
# NFA - Net Floor Area (m2)
panel_17 = Panel(mass_addition_4.PartialResults)

# ----
# User
# Heating Setpoint (.C)
heating_setpoint_c = Slider(20, range=15..25)

# ----
# Air Infiltration (m3/s)
air_infiltration_m3_s = Slider(0.00025, range=0..0.002)

# ----
# Cooling Setpoint (.C)
cooling_setpoint_c = Slider(40, range=18..40)

# ----
# Working hours (h)
working_hours_h = Slider(9, range=5..12)
day_s_start_h = Slider(8, range=6..10)

# ----
# Occupancy (nb. ppl.)
occupancy_nb_ppl = Slider(3, range=0..30)

bool_2 = Boolean(True)
heating_setpoint_october = Slider(21, range=0..30)
heating_setpoint_september = Slider(21, range=0..30)
num_12 = Number(24)
num_13 = Number(0)
series = Series(Start=num_13, Step=num_13, Count=num_12)

num_14 = Number([0, 0, 0, 0, 0, 0, 0, 1, 0, 0, 0, 0, 0, 0, 0, 0, 0, 0, 0, 0, 0, 0, 0, 0])
num_15 = Number(0)
num_16 = Number([0, 0, 0, 0, 0, 0, 0, 0, 1, 1, 1, 1, 1, 1, 1, 1, 1, 0, 0, 0, 0, 0, 0, 0])
constantschedule = HBConstantSchedule(values=series, name="Constant schedule ventilation (Off)", type_limit="On-Off")  # -> report, schedule, idf_text; plug-in component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
# Ventilation schedule
weeklyschedule = HBWeeklySchedule(sun=num_15, mon=num_16, tue=num_16, wed=num_16, thu=num_16, fri=num_16, sat=num_15, name="Daily ventilation schedule")  # -> report, schedule, idf_year, idf_week, idf_days; plug-in component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
weeklyschedule_2 = HBWeeklySchedule(sun=num_15, mon=num_14, tue=num_14, wed=num_14, thu=num_14, fri=num_14, sat=num_15, name="Morning ventilation schedule")  # -> report, schedule, idf_year, idf_week, idf_days; plug-in component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

analysisperiod = LBAnalysisPeriod(
    start_month=Slider(1, range=0..12),
    start_day=Slider(1, range=0..31),
    start_hour=Slider(7.75, range=0..24),
    end_month=Slider(12, range=0..12),
    end_day=Slider(31, range=0..31),
    end_hour=Slider(8, range=0..24))  # -> period, hoys, dates; plug-in component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
analysisperiod_2 = LBAnalysisPeriod(
    start_month=Slider(8, range=0..12),
    start_day=Slider(1, range=0..31),
    start_hour=Slider(8, range=0..31),
    end_month=Slider(12, range=0..12),
    end_day=Slider(31, range=0..31),
    end_hour=Slider(17, range=0..31))  # -> period, hoys, dates; plug-in component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
# Ventilation analysis period
seasonalschedule = HBSeasonalSchedule(base_schedule=constantschedule.schedule, season_scheds=weeklyschedule_2.schedule, analysis_periods=analysisperiod.period)  # -> out, schedule, idf_year, idf_week, idf_days; plug-in component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

analysisperiod_3 = LBAnalysisPeriod(
    start_month=Slider(4, range=1..12),
    start_day=Slider(1, range=1..31),
    start_hour=Slider(8, range=0..24),
    end_month=Slider(7, range=1..12),
    end_day=Slider(31, range=1..31),
    end_hour=Slider(17, range=1..24))  # -> period, hoys, dates; plug-in component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
analysisperiod_4 = LBAnalysisPeriod(
    start_month=Slider(9, range=1..12),
    start_day=Slider(1, range=1..31),
    start_hour=Slider(8, range=0..24),
    end_month=Slider(9, range=1..12),
    end_day=Slider(30, range=1..31),
    end_hour=Slider(17, range=0..24))  # -> period, hoys, dates; plug-in component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
num_17 = Number(0)
constantschedule_2 = HBConstantSchedule(values=num_17, name="constant schedule people", type_limit="On-Off")  # -> report, schedule, idf_text; plug-in component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
analysisperiod_5 = LBAnalysisPeriod(
    start_month=Slider(1, range=0..12),
    start_day=Slider(1, range=0..31),
    start_hour=Slider(8, range=0..31),
    end_month=Slider(2, range=0..31),
    end_day=Slider(6, range=0..21),
    end_hour=Slider(17, range=0..31))  # -> period, hoys, dates; plug-in component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
analysisperiod_6 = LBAnalysisPeriod(
    start_month=Slider(2, range=0..12),
    start_day=Slider(7, range=0..31),
    start_hour=Slider(8, range=0..31),
    end_month=Slider(3, range=0..31),
    end_day=Slider(31, range=0..31),
    end_hour=Slider(17, range=0..31))  # -> period, hoys, dates; plug-in component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
num_18 = Number(1)
ventilation = HBVentilation(ach=num_18, schedule=seasonalschedule.schedule)  # -> vent; plug-in component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
analysisperiod_7 = LBAnalysisPeriod(
    start_month=Slider(4, range=0..12),
    start_day=Slider(1, range=0..31),
    start_hour=Slider(8, range=0..31),
    end_month=Slider(8, range=0..31),
    end_day=Slider(31, range=0..31),
    end_hour=Slider(17, range=0..31))  # -> period, hoys, dates; plug-in component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
analysisperiod_8 = LBAnalysisPeriod(
    start_month=Slider(9, range=0..12),
    start_day=Slider(1, range=0..31),
    start_hour=Slider(8, range=0..31),
    end_month=Slider(12, range=0..31),
    end_day=Slider(31, range=0..31),
    end_hour=Slider(17, range=0..31))  # -> period, hoys, dates; plug-in component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
merge_4 = Merge(
    Data1=analysisperiod_5.period,
    Data2=analysisperiod_6.period,
    Data3=analysisperiod_7.period,
    Data4=analysisperiod_8.period)
panel_18 = Panel(merge_4)
boolean_toggle = BooleanToggle(True)
simoutput = HBSimulationOutput(
    zone_energy_use=boolean_toggle,
    hvac_energy_use=boolean_toggle,
    gains_and_losses=boolean_toggle,
    comfort_metrics=boolean_toggle,
    surface_energy_flow=boolean_toggle)  # -> out, sim_output; plug-in component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
panel_19 = Panel("C:\WaterSkater_example\2024_FRA_AR_Grenoble.074850_TMYx.epw")
epwtoddy = LBEPWToDDY(weather_file=panel_19, write=boolean_toggle)  # -> ddy_file; plug-in component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
analysisperiod_9 = LBAnalysisPeriod(
    start_month=Slider(1, range=0..12),
    start_day=Slider(1, range=0..31),
    start_hour=Slider(0, range=0..24),
    end_month=Slider(12, range=0..12),
    end_day=Slider(31, range=0..31),
    end_hour=Slider(23, range=0..24))  # -> period, hoys, dates; plug-in component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
sizingpar = HBSizingParameter(ddy_file=epwtoddy)  # -> sizing; plug-in component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
simpar = HBSimulationParameter(output=simoutput.sim_output, run_period=analysisperiod_9.period, timestep=6, sizing=sizingpar)  # -> sim_par; plug-in component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

# ----
# Set Up Rooms
boolean_toggle_2 = BooleanToggle(True)
aperture_2 = HBAperture(geo=windows, operable=Toggle(True))  # -> out, apertures; plug-in component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
door_2 = HBDoor(geo=doors, glass=bool_2)  # -> out, doors; plug-in component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

# ----
# Setpoint values
heating_setpoint_april_may_june_july = Slider(22, range=10..35)
heating_setpoint_nov_dez = Slider(20.5, range=10..35)
heating_setpoint_jan = Slider(20.5, range=10..35)
heating_setpoint_mar = Slider(22.3, range=10..35)
heating_setpoint_feb = Slider(21.5, range=10..35)

# ----
# Program
panel_20 = Panel("Temperature")
addition = Addition(A=day_s_start_h, B=working_hours_h)
subtraction = Subtraction(A=24, B=addition)
series_2 = Series(Start=1, Step=0, Count=working_hours_h)
series_3 = Series(Start=0, Step=0, Count=day_s_start_h)
series_4 = Series(Start=0, Step=0, Count=subtraction)
merge_5 = Merge(Data1=series_3, Data2=series_2, Data3=series_4)
constantschedule_3 = HBConstantSchedule(values=heating_setpoint_c, name="Constant schedule heating", type_limit=panel_20)  # -> out, schedule, idf_text; plug-in component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
constantschedule_4 = HBConstantSchedule(values=cooling_setpoint_c, name="Schedule cooling", type_limit=panel_20)  # -> out, schedule, idf_text; plug-in component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
division = Division(A=occupancy_nb_ppl, B=panel_17)
infiltration = HBInfiltration(flow_per_ext_area=air_infiltration_m3_s)  # -> infil; plug-in component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

weeklyschedule_3 = HBWeeklySchedule(sun="0", mon=merge_5, tue=merge_5, wed=merge_5, thu=merge_5, fri=merge_5, sat="0", name="Weekly schedule people")  # -> out, schedule, idf_year, idf_week, idf_days; plug-in component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
merge_6 = Merge(
    Data1=weeklyschedule_3.schedule,
    Data2=weeklyschedule_3.schedule,
    Data3=weeklyschedule_3.schedule,
    Data4=weeklyschedule_3.schedule)

constantschedule_5 = HBConstantSchedule(values=heating_setpoint_jan, type_limit=panel_20)  # -> out, schedule, idf_text; plug-in component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
constantschedule_6 = HBConstantSchedule(values=heating_setpoint_mar, type_limit=panel_20)  # -> out, schedule, idf_text; plug-in component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
constantschedule_7 = HBConstantSchedule(values=heating_setpoint_feb, type_limit=panel_20)  # -> out, schedule, idf_text; plug-in component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
constantschedule_8 = HBConstantSchedule(values=heating_setpoint_april_may_june_july, type_limit=panel_20)  # -> out, schedule, idf_text; plug-in component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
constantschedule_9 = HBConstantSchedule(values=heating_setpoint_nov_dez, type_limit=panel_20)  # -> out, schedule, idf_text; plug-in component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

constantschedule_10 = HBConstantSchedule(values=heating_setpoint_september, type_limit=panel_20)  # -> report, schedule, idf_text; plug-in component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
constantschedule_11 = HBConstantSchedule(values=heating_setpoint_october, type_limit=panel_20)  # -> report, schedule, idf_text; plug-in component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
merge_7 = Merge(
    Data1=constantschedule_5.schedule,
    Data2=constantschedule_7.schedule,
    Data3=constantschedule_6.schedule,
    Data4=constantschedule_8.schedule,
    Data5=constantschedule_10.schedule,
    Data6=constantschedule_11.schedule,
    Data7=constantschedule_9.schedule)
seasonalschedule_2 = HBSeasonalSchedule(base_schedule=constantschedule_2.schedule, season_scheds=merge_6, analysis_periods=merge_4, name="schedule people")  # -> out, schedule, idf_year, idf_week, idf_days; plug-in component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

# ----
# Heating Schedule
# Setpoint Month
number_slider_2 = Slider(31, range=1..31)
analysisperiod_10 = LBAnalysisPeriod(
    start_month=Slider(2, range=1..12),
    start_day=Slider(1, range=1..31),
    start_hour=Slider(8, range=0..24),
    end_month=Slider(2, range=1..12),
    end_day=Slider(31, range=1..31),
    end_hour=Slider(17, range=1..24))  # -> period, hoys, dates; plug-in component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
analysisperiod_11 = LBAnalysisPeriod(
    start_month=Slider(3, range=1..12),
    start_day=Slider(1, range=1..31),
    start_hour=Slider(8, range=0..24),
    end_month=Slider(3, range=1..12),
    end_day=Slider(31, range=1..31),
    end_hour=Slider(17, range=1..24))  # -> period, hoys, dates; plug-in component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
analysisperiod_12 = LBAnalysisPeriod(
    start_month=Slider(1, range=1..12),
    start_day=Slider(1, range=1..31),
    start_hour=Slider(9, range=0..24),
    end_month=Slider(1, range=1..12),
    end_day=Slider(31, range=1..31),
    end_hour=Slider(17, range=1..24))  # -> period, hoys, dates; plug-in component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
analysisperiod_13 = LBAnalysisPeriod(
    start_month=Slider(10, range=1..12),
    start_day=Slider(1, range=1..31),
    start_hour=Slider(8, range=0..24),
    end_month=Slider(10, range=1..12),
    end_day=Slider(31, range=1..31),
    end_hour=Slider(17, range=1..24))  # -> period, hoys, dates; plug-in component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
analysisperiod_14 = LBAnalysisPeriod(
    start_month=Slider(11, range=1..12),
    start_day=Slider(1, range=1..31),
    start_hour=Slider(8, range=0..24),
    end_month=Slider(12, range=1..12),
    end_day=number_slider_2,
    end_hour=Slider(17, range=1..24))  # -> period, hoys, dates; plug-in component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

merge_8 = Merge(
    Data1=analysisperiod_12.period,
    Data2=analysisperiod_10.period,
    Data3=analysisperiod_11.period,
    Data4=analysisperiod_3.period,
    Data5=analysisperiod_4.period,
    Data6=analysisperiod_13.period,
    Data7=analysisperiod_14.period)

seasonalschedule_3 = HBSeasonalSchedule(
    base_schedule=constantschedule_3.schedule,
    season_scheds=merge_7,
    analysis_periods=merge_8,
    name="Seasonal schedule heating")  # -> out, schedule, idf_year, idf_week, idf_days; plug-in component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

people = HBPeople(ppl_per_area=division, occupancy_sch=seasonalschedule_2.schedule)  # -> people; plug-in component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
setpoint = HBSetpoint(name="heating setpoints", heating_sch=seasonalschedule_3.schedule, cooling_sch=constantschedule_4.schedule)  # -> setpoint; plug-in component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
programtype = HBProgramType(name="Grenoble_Earth_House", people=people, infiltration=infiltration, ventilation=ventilation, setpoint=setpoint)  # -> program; plug-in component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

roomsolid_2 = HBRoomFromSolid(geo=flatten(closedsrfbuilding), constr_set=constructionset, program=programtype, conditioned=boolean_toggle_2)  # -> out, rooms; plug-in component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
addsubface_2 = HBAddSubface(hb_obj=flatten(roomsolid_2.rooms), sub_faces=flatten([aperture_2.apertures, door_2.doors]))  # -> hb_obj; plug-in component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
louvershades = HBLouverShades(hb_objs=flatten(addsubface_2), depth="0.05", shade_count="8")  # -> readMe, hb_objs; plug-in component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
bordershades = HBExtrudedBorderShades(hb_objs=flatten(louvershades.hb_objs), depth="0.2")  # -> out, hb_objs; plug-in component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
model_2 = HBModel(rooms=flatten(bordershades.hb_objs), doors=flatten(door_2.doors), name="Grenoble earth building model")  # -> out, model; plug-in component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
panel_21 = Panel(model_2.model)

panel_22 = Panel(programtype)
panel_23 = Panel(seasonalschedule_3.schedule)

# ----
# Display
facesbytype_2 = HBFacesByType(hb_objs=model_2.model)  # -> walls, interior_walls, roofs, ceilings, exterior_floors, interior_floors, air_walls, apertures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; plug-in component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
vizquick_7 = HBVizualizeQuick(hb_objs=flatten(facesbytype_2.doors))  # -> geo; plug-in component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
vizquick_8 = HBVizualizeQuick(hb_objs=flatten(facesbytype_2.outdoor_shades))  # -> geo; plug-in component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
vizquick_9 = HBVizualizeQuick(hb_objs=flatten(facesbytype_2.walls))  # -> geo; plug-in component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
vizquick_10 = HBVizualizeQuick(hb_objs=flatten(facesbytype_2.roofs))  # -> geo; plug-in component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
vizquick_11 = HBVizualizeQuick(hb_objs=flatten(facesbytype_2.exterior_floors))  # -> geo; plug-in component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
vizquick_12 = HBVizualizeQuick(hb_objs=flatten(facesbytype_2.apertures))  # -> geo; plug-in component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
custom_preview = CustomPreview(Geometry=vizquick_7, Material=ColourSwatch(SwatchColor=RGBA(32, 82, 117, 17)))
custom_preview_2 = CustomPreview(Geometry=vizquick_9, Material=ColourSwatch(SwatchColor=RGB(255, 255, 255)))
custom_preview_3 = CustomPreview(Geometry=vizquick_10, Material=ColourSwatch(SwatchColor=RGB(222, 222, 222)))
custom_preview_4 = CustomPreview(Geometry=vizquick_11, Material=ColourSwatch(SwatchColor=RGB(255, 255, 255)))
custom_preview_5 = CustomPreview(Geometry=vizquick_12, Material=ColourSwatch(SwatchColor=RGBA(32, 82, 117, 17)))
custom_preview_6 = CustomPreview(Geometry=vizquick_8, Material=ColourSwatch(SwatchColor=RGBA(32, 82, 117, 17)))

# ----
# HVAC system
idealair = HBIdealAir(rooms=flatten(model_2.model), dcv=Toggle(False), heat_limit="autosize")  # -> report, rooms; plug-in component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

# ----
# Thermal simulation (hourly)
model_3 = HBModel(rooms=flatten(idealair.rooms))  # -> out, model; plug-in component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
boolean_toggle_3 = BooleanToggle(True)
modeltoosm = HBModelToOSM(model=model_3.model, epw_file=panel_19, sim_par=simpar, write=boolean_toggle_3, run=boolean_toggle_3)  # -> out, jsons, osw, osm, idf, sql, zsz, rdd, html; plug-in component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

eui = HBEndUseIntensity(sql=modeltoosm.sql)  # -> eui, eui_end_use, end_uses, gross_floor; plug-in component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
panel_24 = Panel(modeltoosm.idf)
panel_25 = Panel(eui.eui_end_use)
panel_26 = Panel(eui.end_uses)

# ----
# Hygrothermal simulation
panel_27 = Panel("C:\WaterSkater_example\0. Baseline\Excel with properties calibration final_.xlsx")
waterskater = WaterSkater(idf=modeltoosm.idf, additional_input=panel_27, epw_file=panel_19, run=Toggle(True))  # -> out, zsz, rdd, html, err
#   port err: sql, zsz, rdd, html: Standard return of EP run The path to the modified idf
# ---------- waterskater: Python ----------
"""Transform a idf to Hygrothermal version.
    Inputs:
        _idf: The path to the idf file from the previous component
        _additional_input: Addtional information that needs to be written to the idf file,
                           in the format of Excel
        _epw_file: a file sent to EP together with idf
        _run: set to True to run the whole component
    Output:
        sql: The file path of the SQL result file that has been generated on this
            computer. This will be None unless run_ is set to True.
        zsz: Path to a .csv file containing detailed zone load information recorded
            over the course of the design days. This will be None unless run_ is
            set to True.
        rdd: The file path of the Result Data Dictionary (.rdd) file that is
            generated after running the file through EnergyPlus.  This file
            contains all possible outputs that can be requested from the EnergyPlus
            model. Use the "HB Read Result Dictionary" component to see what outputs
            can be requested.
        html: The HTML file path containing all requested Summary Reports.
"""

__author__ = "hchuanshan"
__version__ = "2023.09.19"

path_to_new_idf = r"C:\WaterSkater_example\0. Baseline\Results\modified.idf"
path_to_final_idf = r"C:\WaterSkater_example\0. Baseline\Results\final.idf"
# Surface Temperature Upper Limit
STUL = "200"
line_beneath_alg = 2

ghenv.Component.Name = 'WaterSkater'
ghenv.Component.NickName = 'WaterSkater'
import os
import rhinoscriptsyntax as rs
import clr
clr.AddReference("Microsoft.Office.Interop.Excel")
import Microsoft.Office.Interop.Excel as excel
import shutil

from honeybee_energy.simulation.parameter import SimulationParameter
from honeybee_energy.run import to_openstudio_osw, run_osw, run_idf, \
        output_energyplus_files
from honeybee_energy.result.err import Err
from honeybee_energy.result.osw import OSW
from honeybee_energy.config import folders as energy_folders
        

# Helper funcs
def getallobjlists(idf, refname):
    """get all object-list fields for refname
    return a list:
    [('OBJKEY', refname, fieldindexlist), ...] where
    fieldindexlist = index of the field where the object-list = refname
    """
    dtls = idf.model.dtls
    objlists = []
    for i, fieldidds in enumerate(idf.idd_info):
        indexlist = []
        for j, fieldidd in enumerate(fieldidds):
            if "object-list" in fieldidd:
                if fieldidd["object-list"][0].upper() == refname.upper():
                    indexlist.append(j)
        if indexlist != []:
            objkey = dtls[i]
            objlists.append((objkey, refname, indexlist))
    return objlists
    
def idfreader(fname, iddfile, conv=True):
    """read idf file and return bunches"""
    data, commdct, idd_index = readidf.readdatacommdct(fname, iddfile=iddfile)
    if conv:
        convertallfields(data, commdct)
    # fill gaps in idd
    ddtt, dtls = data.dt, data.dtls
    # skiplist = ["TABLE:MULTIVARIABLELOOKUP"]
    nofirstfields = iddgaps.missingkeys_standard(
        commdct, dtls, skiplist=["TABLE:MULTIVARIABLELOOKUP"]
    )
    iddgaps.missingkeys_nonstandard(None, commdct, dtls, nofirstfields)
    bunchdt = makebunches(data, commdct)
    return bunchdt, data, commdct, idd_index
    
if _run:
    ex = excel.ApplicationClass()
    # Open Workbooks
    workbook = ex.Workbooks.Open(_additional_input)
    worksheet = workbook.Worksheets[1]

    rows = worksheet.UsedRange.Rows.Count
    cols = worksheet.UsedRange.Columns.Count
    num_of_mat = 0
    
    # get the row number of each materials
    row_nums = [] 
    for row in range(1, rows + 1):
        cell = worksheet.UsedRange.Item(row, 2)
        if cell.Value2 is not None:
            num_of_mat += 1
            row_nums.append(row)
            
    
    # Add the additional input from the excel file to idf
    with open(_idf, 'r') as input_file, open(path_to_new_idf, 'w+') as newf:
        # write original content to modified idf
        ignore = 0
        mat_names = []
        
        for line in input_file:# Modify algo and timestep
            if "HeatBalanceAlgorithm," not in line \
                and "Timestep," not in line \
                and "Typical Insulated Carpeted 8in Slab Floor-R5, !- Name" not in line \
                and "Typical Insulation-R31,                 !- Layer 2" not in line \
                and ignore == 0:
                newf.write(line)
            elif "HeatBalanceAlgorithm," in line:
                ignore += line_beneath_alg
                newf.write("HeatBalanceAlgorithm,\n")
                newf.write("    CombinedHeatAndMoistureFiniteElement,\n")
                newf.write("    "+STUL+";\n")
            elif "Timestep," in line:
                ignore += 1
                newf.write("Timestep,\n")
                newf.write("    20;\n")
            elif "Typical Insulated Carpeted 8in Slab Floor-R5, !- Name" in line:
                ignore += 3
                newf.write("    Typical Insulated Carpeted 8in Slab Floor-R5, !- Name\n")
                newf.write("    8 in. Normalweight Concrete Floor;      !- Layer 2\n")
            else:
                ignore -= 1
                if ignore < 0: 
                    ignore = 0
                    
            if "Material," in line: # Read all the material names
                next_line = next(input_file, None)
                newf.write(next_line)
                mat_names.append(next_line.lstrip().split(',')[0])
        
        # write all the material names to the Excel file
        
        for i in range(len(mat_names)): 
            worksheet.Cells[5+15*i, 2].Value = mat_names[i]
            worksheet.Cells[5+15*i, 1].Value = "Material "+str(i+1)
                
        workbook.Save()
        
        
        # Update row_nums
        worksheet = workbook.Worksheets[1]
        rows = worksheet.UsedRange.Rows.Count
        num_of_mat = 0
        row_nums = []
        for row in range(1, rows + 1):
            cell = worksheet.UsedRange.Item(row, 2)
            if cell.Value2 is not None:
                num_of_mat += 1
                row_nums.append(row)
        
        # write additional strings to modified idf
        for row in row_nums: # for each material, print settings:
            newf.write(worksheet.Cells[1, 4].Value2+",\n") # Title
            newf.write("    "+str(worksheet.Cells[row, 2].Value2)+",\n") # material name
            newf.write("    "+str(worksheet.Cells[row, 4].Value2)+",\n") # Porosity
            newf.write("    "+str(worksheet.Cells[row, 5].Value2)+";\n") # Initial Water Content Ratio
            
        for row in row_nums: # for each material, print sorptionisotherm:
            newf.write(worksheet.Cells[1, 6].Value2+",\n") # Title
            newf.write("    "+str(worksheet.Cells[row, 2].Value2)+",\n") # Material name
            newf.write("    "+str(worksheet.Cells[row-2, 7].Value2)+",\n")
            
            try:
                for i in range(int(worksheet.Cells[row-2, 7].Value2)):
                    if i < int(worksheet.Cells[row-2, 7].Value2) - 1:
                        newf.write("    "+str(worksheet.Cells[row + i, 6].Value2)+",\n") #
                        newf.write("    "+str(worksheet.Cells[row + i, 7].Value2)+",\n")
                    else:
                        newf.write("    "+str(worksheet.Cells[row + i, 6].Value2)+",\n") #
                        newf.write("    "+str(worksheet.Cells[row + i, 7].Value2)+";\n")
            except Exception as e:
                print("You may need to check if cell (" + str(row-2) + ", 7) is empty.")
            
        for row in row_nums: # for each material, print suction:
            newf.write(worksheet.Cells[1, 8].Value2+",\n") # Title
            newf.write("    "+str(worksheet.Cells[row, 2].Value2)+",\n") # Material name
            newf.write("    "+str(worksheet.Cells[row-2, 9].Value2)+",\n")
            
            try:
                for i in range(int(worksheet.Cells[row-2, 9].Value2)):
                    if i < int(worksheet.Cells[row-2, 9].Value2) - 1:
                        newf.write("    "+str(worksheet.Cells[row + i, 8].Value2)+",\n")
                        newf.write("    "+str(worksheet.Cells[row + i, 9].Value2)+",\n")
                        
                    else:
                        newf.write("    "+str(worksheet.Cells[row + i, 8].Value2)+",\n")
                        newf.write("    "+str(worksheet.Cells[row + i, 9].Value2)+";\n")
            except Exception as e:
                print("You may need to check if cell (" + str(row) + ", 9) is empty.")
                    
                
        for row in row_nums: # for each material, print redistribution:
            newf.write(worksheet.Cells[1, 10].Value2+",\n") # Title
            newf.write("    "+str(worksheet.Cells[row, 2].Value2)+",\n") # Material name
            newf.write("    "+str(worksheet.Cells[row-2, 11].Value2)+",\n")
            
            try:
                
                for i in range(int(worksheet.Cells[row-2, 11].Value2)):
                    if i < int(worksheet.Cells[row-2, 11].Value2) - 1:
                        newf.write("    "+str(worksheet.Cells[row + i, 10].Value2)+",\n")
                        newf.write("    "+str(worksheet.Cells[row + i, 11].Value2)+",\n")
                        
                    else:
                        newf.write("    "+str(worksheet.Cells[row + i, 10].Value2)+",\n")
                        newf.write("    "+str(worksheet.Cells[row + i, 11].Value2)+";\n")
            except Exception as e:
                print("You may need to check if cell (" + str(row) + ", 11) is empty.")
                    
                
        for row in row_nums: # for each material, print diffusion:
            newf.write(worksheet.Cells[1, 12].Value2+",\n") # Title
            newf.write("    "+str(worksheet.Cells[row, 2].Value2)+",\n") # Material name
            newf.write("    "+str(worksheet.Cells[row-2, 13].Value2)+",\n")
            
            try:
                for i in range(int(worksheet.Cells[row-2, 13].Value2)):
                    if i < int(worksheet.Cells[row-2, 13].Value2) - 1:
                        newf.write("    "+str(worksheet.Cells[row + i, 12].Value2)+",\n")
                        newf.write("    "+str(worksheet.Cells[row + i, 13].Value2)+",\n")
                            
                    else:
                        newf.write("    "+str(worksheet.Cells[row + i, 12].Value2)+",\n")
                        newf.write("    "+str(worksheet.Cells[row + i, 13].Value2)+";\n")
            except Exception as e:
                print("You may need to check if cell (" + str(row) + ", 13) is empty.")
                #print(e.args)
        
        for row in row_nums: # for each material, print thermal conductivity:
            newf.write(worksheet.Cells[1, 14].Value2+",\n") # Title
            newf.write("    "+str(worksheet.Cells[row, 2].Value2)+",\n") # Material name
            newf.write("    "+str(worksheet.Cells[row-2, 15].Value2)+",\n")
            
            try:
                for i in range(int(worksheet.Cells[row-2, 15].Value2)):
                    if i < int(worksheet.Cells[row-2, 15].Value2) - 1:
                        newf.write("    "+str(worksheet.Cells[row + i, 14].Value2)+",\n")
                        newf.write("    "+str(worksheet.Cells[row + i, 15].Value2)+",\n")
                        
                    else:
                        newf.write("    "+str(worksheet.Cells[row + i, 14].Value2)+",\n")
                        newf.write("    "+str(worksheet.Cells[row + i, 15].Value2)+";\n")
            except Exception as e:
                print("You may need to check if cell (" + str(row) + ", 15) is empty.")
                    
        workbook.Close()
        
#        shutil.copy(path_to_new_idf, path_to_final_idf)
#        input_file.close()
#        newf.close()
        
    # After modification, run EP and save the results
    sql, zsz, rdd, html, err = run_idf(path_to_new_idf, _epw_file, silent=False)
    print(sql)
# ---------- end waterskater ----------

panel_28 = Panel(waterskater.out)

# ----
# Indoor air temperature
roomenergyresult = HBReadRoomEnergyResult(sql=modeltoosm.sql)  # -> cooling, heating, lighting, electric_equip, gas_equip, process, hot_water, fan_electric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; plug-in component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
roomcomfortresult = HBReadRoomComfortResult(sql=modeltoosm.sql)  # -> oper_temp, air_temp, rad_temp, rel_humidity; plug-in component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
toggle = BooleanToggle(True)
xdata = LBDeconstructData(data=roomcomfortresult.air_temp)  # -> header, values; plug-in component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
xdata_2 = LBDeconstructData(data=roomcomfortresult.rel_humidity)  # -> header, values; plug-in component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
xdata_3 = LBDeconstructData(data=roomenergyresult.heating)  # -> header, values; plug-in component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
xdata_4 = LBDeconstructData(data=roomenergyresult.cooling)  # -> header, values; plug-in component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
panel_29 = Panel(xdata.values)
panel_30 = Panel(xdata_3.values)
panel_31 = Panel(xdata_2.values)
panel_32 = Panel(xdata_4.values)
flip = FlipMatrix(Data=panel_29)
# Relative humidity
panel_33 = Panel("A2")
flip_2 = FlipMatrix(Data=panel_31)
flip_3 = FlipMatrix(Data=panel_32)
flip_4 = FlipMatrix(Data=panel_30)
panel_34 = Panel("C:\Users\emmal\Desktop\Master Thesis\Grasshopper\Simulation\Baseline simulation\Calibration results\Calibration_results_final.xlsx")
xl_out = WriteToExcelClassic(WorkbookFilepath=panel_34, WorksheetName="Results Thermal", Data=flip, LocationAddress=panel_33, Stream=toggle)
xl_out_2 = WriteToExcelClassic(WorkbookFilepath=panel_34, WorksheetName="Results Thermal", Data=flip_2, LocationAddress="B2", Stream=toggle)
# Cooling
xl_out_3 = WriteToExcelClassic(WorkbookFilepath=panel_34, WorksheetName="Results Thermal", Data=flip_3, LocationAddress="C2", Stream=toggle)
# Heating
xl_out_4 = WriteToExcelClassic(WorkbookFilepath=panel_34, WorksheetName="Results Thermal", Data=flip_4, LocationAddress="D2", Stream=toggle)

panel_35 = Panel(roomenergyresult.mech_vent_load)

# ---- group: New Hygrothermal plugin
# Hygrothermal results
roomcomfortresult_2 = HBReadRoomComfortResult(sql=waterskater.out)  # -> oper_temp, air_temp, rad_temp, rel_humidity; plug-in component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
roomenergyresult_2 = HBReadRoomEnergyResult(sql=waterskater.out)  # -> cooling, heating, lighting, electric_equip, gas_equip, process, hot_water, fan_electric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; plug-in component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
panel_36 = Panel("Results Hygrothermal")
toggle_2 = BooleanToggle(False)
xdata_5 = LBDeconstructData(data=roomcomfortresult_2.rel_humidity)  # -> header, values; plug-in component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
xdata_6 = LBDeconstructData(data=roomcomfortresult_2.air_temp)  # -> header, values; plug-in component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
panel_37 = Panel("C:\Users\emmal\Desktop\Master Thesis\Grasshopper\Simulation\Baseline simulation\Calibration results\Calibration_results_newvent.xlsx")
panel_38 = Panel(xdata_6.values)
panel_39 = Panel(xdata_5.values)
flip_5 = FlipMatrix(Data=panel_38)
flip_6 = FlipMatrix(Data=panel_39)
xl_out_5 = WriteToExcelClassic(WorkbookFilepath=panel_37, WorksheetName=panel_36, Data=flip_5, LocationAddress="A3")
xl_out_6 = WriteToExcelClassic(WorkbookFilepath=panel_37, WorksheetName=panel_36, Data=flip_6, LocationAddress="B3")

# Hygrothermal
panel_40 = Panel("average")
timeop = LBTimeIntervalOperation(data=roomcomfortresult_2.rel_humidity, operation=panel_40)  # -> daily, monthly, mon_per_hr; plug-in component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
eui_2 = HBEndUseIntensity(sql=waterskater.out)  # -> eui, eui_end_use, end_uses, gross_floor; plug-in component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
panel_41 = Panel(eui_2.eui_end_use)
panel_42 = Panel(eui_2.end_uses)

# ----
# Display charts
monthlychart = LBMonthlyChart(data=roomcomfortresult.rel_humidity)  # -> report, data_mesh, data_lines, col_lines, legend, borders, labels, y_title, title, vis_set; plug-in component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

xdata_7 = LBDeconstructData(data=roomenergyresult_2.heating)  # -> header, values; plug-in component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
panel_43 = Panel(xdata_7.values)
flip_7 = FlipMatrix(Data=panel_43)
xl_out_7 = WriteToExcelClassic(WorkbookFilepath=panel_37, WorksheetName=panel_36, Data=flip_7, LocationAddress="C3")
